% Requirement links of Generator_Testrig.slx (R2024b)

block :224 implements Wind_Turbine_Requirements.docx#@Simulink_requirement_item_5: Generator Requirements
block :69 implements Wind_Turbine_Requirements.docx#@Simulink_requirement_item_5: Generator Requirements