% Requirement links of Wind_Turbine.slx (R2024b)

block :250 implements Wind_Turbine_Requirements.docx#@Simulink_requirement_item_10: Nacelle Requirements
block :2567 implements Wind_Turbine_Requirements.docx#@Simulink_requirement_item_2: Yaw Actuation Requirements
block :2578 implements Wind_Turbine_Requirements.docx#@Simulink_requirement_item_3: Pitch Actuation Requirements
block :2603 implements Wind_Turbine_Requirements.docx#@Simulink_requirement_item_4: Geartrain Requirements
block :2645 implements Wind_Turbine_Requirements.docx#@Simulink_requirement_item_7: Yaw Controller Requirements
block :2646 implements Wind_Turbine_Requirements.docx#@Simulink_requirement_item_9: Main Controller Requirements
block :278 implements Wind_Turbine_Requirements.docx#@Simulink_requirement_item_1: Blade Requirements
block :2817 implements Wind_Turbine_Requirements.docx#@Simulink_requirement_item_5: Generator Requirements